# Dynamo graph R23_SHEETREVISIONS.dyn (Dynamo 2.16.2.5624)
# packages: Crumple 2024.4.3, Data-Shapes 2025.3.118

# group: SELECT A REVISION
code_block = CodeBlock { "SELECT A REVISION"; 0; true; }
collect_revisions = Custom[© Collect.Revisions]()  # package Crumple; Returns all revisions in a document.
name = Element.Name(element=collect_revisions)
dropdown_data = Custom[DropDown Data](InputName=code_block.out0, Keys=name, Values=collect_revisions, DefaultValueIndex=code_block.out1, Sorted_optional=code_block.out2)  # package Data-Shapes; Create data for DropDown input in UI.MultiInputForm ++ . Check out www.data-shapes.net for more infos.

# group: SELECT SHEETS
code_block_2 = CodeBlock { "SELECT SHEETS"; }
code_block_3 = CodeBlock { false; }
collect_sheets = Custom[© Collect.Sheets](includePlaceholders=code_block_3)  # package Crumple; Returns all the sheets in a document, with the option to omit any placeholder sheets.
sheetNumber = Sheet.SheetNumber(sheet=collect_sheets)
sheetName = Sheet.SheetName(sheet=collect_sheets)
code_block_4 = CodeBlock(nu=sheetNumber, na=sheetName) { nu + ": " + na; }
code_block_5 = CodeBlock { 300; true; false; }
listview_data = Custom[Listview Data](InputName=code_block_2, Keys=code_block_4, Values=collect_sheets, Height_optionnal=code_block_5.out0, HilightInView_optionnal=code_block_5.out2, DisplayModeOnly_optionnal=code_block_5.out2, ShowElementCount_optionnal=code_block_5.out2, SortItems_optionnal=code_block_5.out1, ShowId_optionnal=code_block_5.out2)  # package Data-Shapes; Create data for ListView input in UI.MultiInputForm ++ . Check out www.data-shapes.net for more infos.

# group: ADD
code_block_6 = CodeBlock { "ADD / REMOVE"; true; "CHECK to ADD -or- UNCHECK to REMOVE"; }
boolean_input = Custom[Boolean input](InputName=code_block_6.out0, DefaultValue=code_block_6.out1, SideText=code_block_6.out2)  # package Data-Shapes; Creates a boolean input for UI.MultipleInputForm ++ . Check out www.data-shapes.net for more infos!

# group: USER INTERFACE
code_block_7 = CodeBlock { "ADD REVISIONS TO SHEETS"; "RUN"; "CANCEL"; 1000; 600; 175; }
list_create = List.Create(item0=dropdown_data, item1=listview_data, item2=boolean_input)
boolean = BoolSelector(true)
multipleinputform = Custom[MultipleInputForm ++](Description_optional=code_block_7.out0, ButtonText_optional=code_block_7.out1, Inputs=list_create, Toggle=boolean, CancelButtonText_optional=code_block_7.out2, MaxHeight_optional=code_block_7.out3, Width_optional=code_block_7.out4, LabelWidth_optional=code_block_7.out5)  # package Data-Shapes; Create a form with multiple inputs. see www.data-shapes.net for tutorials and infos!

code_block_8 = CodeBlock(out=multipleinputform.User_Inputs) { out[0]; out[1]; out[2]; }
sheets_revisionsadd = Custom[© Sheets.RevisionsAdd](sheets=code_block_8.out1, revisions=code_block_8.out0, runMe=code_block_8.out2)  # package Crumple; Given a list of sheets, attempt to add the given revisions to each of those sheets.
not_ = Not(x=code_block_8.out2)
sheets_revisionsremove = Custom[© Sheets.RevisionsRemove](sheets=code_block_8.out1, revisions=code_block_8.out0, runMe=not_)  # package Crumple; Given a list of sheets, attempt to remove given revisions from those sheets.
count = List.Count(list=code_block_8.out1)
string_from_object = FromObject(object=count)
code_block_9 = CodeBlock(n=string_from_object) { "SCRIPT COMPLETED"; n + " SHEETS UPDATED."; }
ui_messenger = Custom[© UI.Messenger](title=code_block_9.out0, body=code_block_9.out1)  # package Crumple; Displays a message box with a title/body and OK/cancel button. If OK is selected, the third input's data will be passed through.
